# Grasshopper definition miuraEggMorphArr.gh (Grasshopper 1.0.7)
# plug-ins: Pufferfish

betamorph = Slider(55, range=1..90)
alphamorph = Slider(65, range=1..90)
amorph = Slider(0.43, range=0.1..3)
rad = Radians(Degrees=betamorph)
expression = Expression(beta=rad, Expression="2*beta")
rad_2 = Radians(Degrees=alphamorph)
psitophimorph = PsiToPhiMorph(alphamorph=rad_2, betamorph=rad, psi=expression, sign="1.0")
deg = Degrees(Radians=psitophimorph)
transition_phi = Panel(deg)
origin = Point(Point(0, 0, 0))
path = FilePath("C:\Users\kl6599\OneDrive - Princeton University\Documents\MATLAB\Miura_Eggbox\giffolder\Frame_00000.png")
path_2 = FilePath("C:\Users\kl6599\OneDrive - Princeton University\Documents\MATLAB\Miura_Eggbox\giffolder\")
input_output_information = InputOutputInformation(SourcePath=path, TargetFolder=path_2, TargetFilename="miura_rotated_gif")  # -> IO; plug-in component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
frames_video = FramesToVideo(IO=input_output_information, Bitrate=12)  # -> Settings; plug-in component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
frames_gif = FramesToGIF(IO=input_output_information)  # -> Settings; plug-in component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
remote = FFmpegRemote(Settings=frames_video, Send=Button())  # plug-in component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

# ---- group: Input Sliders
panel = Panel("""1.0
-1.0""")
ge = Slider(60, range=1..90)
gm = Slider(60, range=1..90)
xcount = Slider(6, range=1..10)
ycount = Slider(6, range=1..10)
bm = Slider(0.14, range=0.1..3)
a = Slider(1, range=0.1..3)
be = Slider(0.43, range=0.1..3)
rad_3 = Radians(Degrees=ge)
rad_4 = Radians(Degrees=gm)
expression_2 = Expression(gm=rad_4, Expression="pi-2*gm")
psitophimorph_2 = PsiToPhiMorph(alphamorph=rad_2, betamorph=rad, psi=expression_2, sign=panel)
deg_2 = Degrees(Radians=psitophimorph_2)
item = ListItem(List=deg_2, Index=1, Wrap=True)
item_2 = ListItem(List=deg_2, Index=0, Wrap=True)

dom = Domain(DomainStart=expr("x*1.0001", item_2), DomainEnd=expr("x*0.9999", item))
phimorph = Slider(0, range=0..1)
remap = RemapNumbers(Value=phimorph, Source=Domain(0, 1), Target=dom)
panel_2 = Panel(remap)
num = Number(panel_2)

rad_5 = Radians(Degrees=num)

# ----
phimorphtopsi = PhiMorphToPsi(alphamorph=rad_2, betamorph=rad, phimorph=rad_5)
expression_3 = Expression(psi=phimorphtopsi, g=rad_4, Expression="asin(sin(psi)/sin(g))")
expression_4 = Expression(psi=phimorphtopsi, Expression="pi/2-psi")
eggcalc = EggCalc(a=a, be=be, ge=rad_3, alphae=expression_4)  # -> hae, hbe, he, se, le
morphcalc = MorphCalc(a=amorph, c=a, alpha=rad_2, beta=rad, phi=rad_5)  # -> hcc, hab, H, l1, l2, L, W
miuracalc = MiuraCalc(a=a, b=bm, g=rad_4, theta=expression_3)  # -> H, S, L, V
miurapoints = MiuraPoints(T=origin, H=miuracalc.H, S=miuracalc.S, L=miuracalc.L, V=miuracalc.V)  # -> G, G_2, G_3, G_4, G_5, G_6, G_7, G_8, G_9
morphpoints = MorphPoints(T=miurapoints.G_7, hcc=morphcalc.hcc, hab=morphcalc.hab, H=morphcalc.H, l1=morphcalc.l1, L=morphcalc.L, W=morphcalc.W)  # -> G, G_2, G_3, G_4, G_5, G_6, G_7, G_8, G_9
eggpoints = EggPoints(T=morphpoints.G_7, ha=eggcalc.hae, hb=eggcalc.hbe, H=eggcalc.he, se=eggcalc.se, le=eggcalc.le)  # -> G, G_2, G_3, G_4, G_5, G_6, G_7, G_8, G_9
morphsurfs = MiuraSurfs(
    p1=morphpoints.G,
    p2=morphpoints.G_2,
    p3=morphpoints.G_3,
    p4=morphpoints.G_4,
    p5=morphpoints.G_5,
    p6=morphpoints.G_6,
    p7=morphpoints.G_7,
    p8=morphpoints.G_8,
    p9=morphpoints.G_9)  # -> S, S_2, S_3, S_4
miurasurfs = MiuraSurfs(
    p1=miurapoints.G,
    p2=miurapoints.G_2,
    p3=miurapoints.G_3,
    p4=miurapoints.G_4,
    p5=miurapoints.G_5,
    p6=miurapoints.G_6,
    p7=miurapoints.G_7,
    p8=miurapoints.G_8,
    p9=miurapoints.G_9)  # -> S, S_2, S_3, S_4
eggsurfs = MiuraSurfs(
    p1=eggpoints.G,
    p2=eggpoints.G_2,
    p3=eggpoints.G_3,
    p4=eggpoints.G_4,
    p5=eggpoints.G_5,
    p6=eggpoints.G_6,
    p7=eggpoints.G_7,
    p8=eggpoints.G_8,
    p9=eggpoints.G_9)  # -> S, S_2, S_3, S_4
expression_5 = Expression(x=miuracalc.S, y=eggcalc.se, Expression="2*(x+y)")
tube_unit_cell = Merge(
    Data1=miurasurfs.S,
    Data2=miurasurfs.S_2,
    Data3=miurasurfs.S_3,
    Data4=miurasurfs.S_4,
    Data5=eggsurfs.S,
    Data6=eggsurfs.S_2,
    Data7=eggsurfs.S_3,
    Data8=eggsurfs.S_4,
    Data9=morphsurfs.S,
    Data10=morphsurfs.S_2,
    Data11=morphsurfs.S_3,
    Data12=morphsurfs.S_4)
group = Group(Objects=[miurapoints.G, eggpoints.G_9])
group_2 = Group(Objects=tube_unit_cell)
series = Series(Start=0, Step=expression_5, Count=xcount)
brec = BoundingRectangle(Geometry=group, Plane=PlaneXY(0, 0, 0), Axis=0, Slide=0, Union=True)  # -> Bounding, DimensionX, DimensionY
vec = VectorXYZ(XComponent=series, YComponent=0, ZComponent=0)  # -> Vector, Length
arrrec = RectangularArray(Geometry=group_2, Cell=brec.Bounding, XCount=xcount, YCount=ycount)  # -> Geometry, Transform
move = Move(Geometry=group_2, Motion=vec.Vector)  # -> Geometry, Transform
series_2 = Series(Start=0, Step=miuracalc.L, Count=ycount)
series_3 = Series(Start=0, Step=miuracalc.H, Count=ycount)
series_4 = Series(Start=0, Step=expr("-x", miuracalc.L), Count=10)
group_3 = Group(Objects=move.Geometry)
vec_2 = VectorXYZ(XComponent=0, YComponent=series_2, ZComponent=series_3)  # -> Vector, Length
series_5 = Series(Start=0, Step=miuracalc.H, Count=10)
move_2 = Move(Geometry=group_3, Motion=vec_2.Vector)  # -> Geometry, Transform
vec_3 = VectorXYZ(XComponent=0, YComponent=series_4, ZComponent=series_5)  # -> Vector, Length
group_4 = Group(Objects=move_2.Geometry)
move_3 = Move(Geometry=group_4, Motion=vec_3.Vector)  # -> Geometry, Transform
group_5 = Group(Objects=move_3.Geometry)

# ==== cluster PsiToPhiMorph
alphamorph = ClusterInput()
betamorph = ClusterInput()
psi = ClusterInput()
sign = ClusterInput()
expression = Expression(
    alphaMorph=alphamorph,
    betaMorph=betamorph,
    psi=psi,
    sign=sign,
    Expression="acos((2*cos(alphaMorph)*cos(betaMorph)+sign*sqrt(2*(cos(alphaMorph)^2-cos(betaMorph)^2)*(cos(psi)-cos(2*alphaMorph))+(cos(psi)-cos(2*alphaMorph))^2))/(2*cos(alphaMorph)^2+cos(psi)-cos(2*alphaMorph)))")
expression_2 = Expression(alphaMorph=alphamorph, psi=psi, Expression="acos(cos(alphaMorph)/cos(psi/2))")
expression_3 = Expression(betaMorph=betamorph, psi=psi, Expression="acos(cos(betaMorph)/cos(psi/2))")
expression_4 = Expression(phi1=expression_2, phi2=expression_3, sign=sign, Expression="phi1-sign*phi2")
phimorph = ClusterOutput(expression_4)

# ==== cluster PhiMorphToPsi
alphamorph = ClusterInput()
betamorph = ClusterInput()
phimorph = ClusterInput()
expression = Expression(alphaMorph=alphamorph, betaMorph=betamorph, phiMorph=phimorph, Expression="cos(betaMorph)-cos(alphaMorph)*cos(phiMorph)")
expression_2 = Expression(
    alphaMorph=alphamorph,
    betaMorph=betamorph,
    phiMorph=phimorph,
    xi=expression,
    Expression="acos(cos(2*alphaMorph)+2*xi^2/sin(phiMorph)^2)")
expression_3 = Expression(psiMorph=expression_2, Expression="pi/2-psiMorph/2")
psi = ClusterOutput(expression_3)

# ==== cluster MiuraCalc
a = ClusterInput()
b = ClusterInput()
g = ClusterInput()
theta = ClusterInput()
expression = Expression(b=b, theta=theta, g=g, Expression="b*cos(theta)*tan(g)/sqrt(1+cos(theta)^2*tan(g)^2)")
expression_2 = Expression(a=a, theta=theta, g=g, Expression="a*sqrt(1-sin(theta)^2*sin(g)^2)")
expression_3 = Expression(S=expression, theta=theta, g=g, Expression="S/(tan(g)*cos(theta))")
expression_4 = Expression(a=a, theta=theta, g=g, Expression="a*sin(theta)*sin(g)")
H = ClusterOutput(expression_4)
S = ClusterOutput(expression)
L = ClusterOutput(expression_2)
V = ClusterOutput(expression_3)

# ==== cluster MiuraPoints
T = ClusterInput()
H = ClusterInput()
S = ClusterInput()
L = ClusterInput()
V = ClusterInput()
expression = Expression(x=L, Expression="2*x")
addition = Addition(A=V, B=L)
addition_2 = Addition(A=V, B=expression)
pt3 = ConstructPoint(XCoordinate=0, YCoordinate=expr("2*x", L), ZCoordinate=0)
pt7 = ConstructPoint(XCoordinate=expr("2*x", S), YCoordinate=0, ZCoordinate=0)
pt8 = ConstructPoint(XCoordinate=expr("2*x", S), YCoordinate=L, ZCoordinate=H)
pt9 = ConstructPoint(XCoordinate=expr("2*x", S), YCoordinate=expr("2*x", L), ZCoordinate=0)
pt1 = ConstructPoint(XCoordinate=0, YCoordinate=0, ZCoordinate=0)
pt2 = ConstructPoint(XCoordinate=0, YCoordinate=L, ZCoordinate=H)
pt4 = ConstructPoint(XCoordinate=S, YCoordinate=V, ZCoordinate=0)
pt5 = ConstructPoint(XCoordinate=S, YCoordinate=addition, ZCoordinate=H)
pt6 = ConstructPoint(XCoordinate=S, YCoordinate=addition_2, ZCoordinate=0)
move = Move(Geometry=pt1, Motion=T)  # -> Geometry, Transform
move_2 = Move(Geometry=pt2, Motion=T)  # -> Geometry, Transform
move_3 = Move(Geometry=pt3, Motion=T)  # -> Geometry, Transform
move_4 = Move(Geometry=pt4, Motion=T)  # -> Geometry, Transform
move_5 = Move(Geometry=pt5, Motion=T)  # -> Geometry, Transform
move_6 = Move(Geometry=pt6, Motion=T)  # -> Geometry, Transform
move_7 = Move(Geometry=pt7, Motion=T)  # -> Geometry, Transform
move_8 = Move(Geometry=pt8, Motion=T)  # -> Geometry, Transform
move_9 = Move(Geometry=pt9, Motion=T)  # -> Geometry, Transform
G = ClusterOutput(move.Geometry)
G_2 = ClusterOutput(move_2.Geometry)
G_3 = ClusterOutput(move_3.Geometry)
G_4 = ClusterOutput(move_4.Geometry)
G_5 = ClusterOutput(move_5.Geometry)
G_6 = ClusterOutput(move_6.Geometry)
G_7 = ClusterOutput(move_7.Geometry)
G_8 = ClusterOutput(move_8.Geometry)
G_9 = ClusterOutput(move_9.Geometry)

# ==== cluster MiuraSurfs
p1 = ClusterInput()
p2 = ClusterInput()
p3 = ClusterInput()
p4 = ClusterInput()
p5 = ClusterInput()
p6 = ClusterInput()
p7 = ClusterInput()
p8 = ClusterInput()
p9 = ClusterInput()
merge = Merge(Data1=p1, Data2=p2, Data3=p4, Data4=p5)
merge_2 = Merge(Data1=p2, Data2=p3, Data3=p5, Data4=p6)
merge_3 = Merge(Data1=p4, Data2=p5, Data3=p7, Data4=p8)
merge_4 = Merge(Data1=p5, Data2=p6, Data3=p8, Data4=p9)
srfgrid = SurfaceFromPoints(Points=merge, UCount=2, Interpolate=False)
srfgrid_2 = SurfaceFromPoints(Points=merge_2, UCount=2, Interpolate=False)
srfgrid_3 = SurfaceFromPoints(Points=merge_3, UCount=2, Interpolate=False)
srfgrid_4 = SurfaceFromPoints(Points=merge_4, UCount=2, Interpolate=False)
S = ClusterOutput(srfgrid)
S_2 = ClusterOutput(srfgrid_2)
S_3 = ClusterOutput(srfgrid_3)
S_4 = ClusterOutput(srfgrid_4)

# ==== cluster EggCalc
alphae = ClusterInput()
a = ClusterInput()
be = ClusterInput()
ge = ClusterInput()
expression = Expression(be=be, ge=ge, alphae=alphae, Expression="be*sqrt(1-cos(ge)^2/cos(alphae)^2)")
expression_2 = Expression(alphae=alphae, ge=ge, Expression="acos(cos(ge)/cos(alphae))")
expression_3 = Expression(a=a, alphae=alphae, Expression="a*cos(alphae)")
expression_4 = Expression(be=be, betae=expression_2, Expression="be*cos(betae)")
expression_5 = Expression(a=a, alphae=alphae, Expression="a*sin(alphae)")
addition = Addition(A=expression_3, B=expression_4)
hae = ClusterOutput(expression_3)
hbe = ClusterOutput(expression_4)
he = ClusterOutput(addition)
se = ClusterOutput(expression)
le = ClusterOutput(expression_5)

# ==== cluster EggPoints
T = ClusterInput()
ha = ClusterInput()
hb = ClusterInput()
H = ClusterInput()
se = ClusterInput()
le = ClusterInput()
pt6 = ConstructPoint(XCoordinate=se, YCoordinate=expr("2*x", le), ZCoordinate=hb)
pt3 = ConstructPoint(XCoordinate=0, YCoordinate=expr("2*x", le), ZCoordinate=0)
pt7 = ConstructPoint(XCoordinate=expr("2*x", se), YCoordinate=0, ZCoordinate=0)
pt8 = ConstructPoint(XCoordinate=expr("2*x", se), YCoordinate=le, ZCoordinate=ha)
pt9 = ConstructPoint(XCoordinate=expr("2*x", se), YCoordinate=expr("2*x", le), ZCoordinate=0)
pt1 = ConstructPoint(XCoordinate=0, YCoordinate=0, ZCoordinate=0)
pt2 = ConstructPoint(XCoordinate=0, YCoordinate=le, ZCoordinate=ha)
pt4 = ConstructPoint(XCoordinate=se, YCoordinate=0, ZCoordinate=hb)
pt5 = ConstructPoint(XCoordinate=se, YCoordinate=le, ZCoordinate=H)
move = Move(Geometry=pt1, Motion=T)  # -> Geometry, Transform
move_2 = Move(Geometry=pt2, Motion=T)  # -> Geometry, Transform
move_3 = Move(Geometry=pt3, Motion=T)  # -> Geometry, Transform
move_4 = Move(Geometry=pt4, Motion=T)  # -> Geometry, Transform
move_5 = Move(Geometry=pt5, Motion=T)  # -> Geometry, Transform
move_6 = Move(Geometry=pt6, Motion=T)  # -> Geometry, Transform
move_7 = Move(Geometry=pt7, Motion=T)  # -> Geometry, Transform
move_8 = Move(Geometry=pt8, Motion=T)  # -> Geometry, Transform
move_9 = Move(Geometry=pt9, Motion=T)  # -> Geometry, Transform
G = ClusterOutput(move.Geometry)
G_2 = ClusterOutput(move_2.Geometry)
G_3 = ClusterOutput(move_3.Geometry)
G_4 = ClusterOutput(move_4.Geometry)
G_5 = ClusterOutput(move_5.Geometry)
G_6 = ClusterOutput(move_6.Geometry)
G_7 = ClusterOutput(move_7.Geometry)
G_8 = ClusterOutput(move_8.Geometry)
G_9 = ClusterOutput(move_9.Geometry)

# ==== cluster MorphCalc
a = ClusterInput()
c = ClusterInput()
alpha = ClusterInput()
beta = ClusterInput()
phi = ClusterInput()
expression = Expression(alpha=alpha, beta=beta, phi=phi, Expression="cos(beta)-cos(alpha)*cos(phi)")
expression_2 = Expression(alpha=alpha, beta=beta, phi=phi, xi=expression, Expression="acos(cos(2*alpha)+2*xi^2/sin(phi)^2)")
expression_3 = Expression(a=a, alpha=alpha, beta=beta, Expression="a*abs(cos(alpha)/cos(beta))")
expression_4 = Expression(alpha=alpha, psi=expression_2, Expression="acos(cos(alpha)/cos(psi/2))")
expression_5 = Expression(beta=beta, psi=expression_2, Expression="acos(cos(beta)/cos(psi/2))")
expression_6 = Expression(a=a, b=expression_3, phi=phi, Expression="sqrt(a^2+b^2-2*a*b*cos(phi))")
expression_7 = Expression(a=a, phi1=expression_4, Expression="a*cos(phi1)")
expression_8 = Expression(c=c, psi=expression_2, Expression="c*cos(psi/2)")
expression_9 = Expression(a=a, phi1=expression_4, Expression="a*sin(phi1)")
expression_10 = Expression(b=expression_3, phi2=expression_5, Expression="b*sin(phi2)")
expression_11 = Expression(c=c, psi=expression_2, Expression="2*c*sin(psi/2)")
addition = Addition(A=expression_8, B=expression_7)
hcc = ClusterOutput(expression_8)
hab = ClusterOutput(expression_7)
H = ClusterOutput(addition)
l1 = ClusterOutput(expression_9)
l2 = ClusterOutput(expression_10)
L = ClusterOutput(expression_6)
W = ClusterOutput(expression_11)

# ==== cluster MorphPoints
T = ClusterInput()
hcc = ClusterInput()
hab = ClusterInput()
H = ClusterInput()
l1 = ClusterInput()
L = ClusterInput()
W = ClusterInput()
pt2 = ConstructPoint(XCoordinate=0, YCoordinate=expr("x/2", W), ZCoordinate=hcc)
pt5 = ConstructPoint(XCoordinate=l1, YCoordinate=expr("x/2", W), ZCoordinate=H)
pt8 = ConstructPoint(XCoordinate=L, YCoordinate=expr("x/2", W), ZCoordinate=hcc)
pt1 = ConstructPoint(XCoordinate=0, YCoordinate=0, ZCoordinate=0)
pt4 = ConstructPoint(XCoordinate=l1, YCoordinate=0, ZCoordinate=hab)
pt6 = ConstructPoint(XCoordinate=l1, YCoordinate=W, ZCoordinate=hab)
pt3 = ConstructPoint(XCoordinate=0, YCoordinate=W, ZCoordinate=0)
pt7 = ConstructPoint(XCoordinate=L, YCoordinate=0, ZCoordinate=0)
pt9 = ConstructPoint(XCoordinate=L, YCoordinate=W, ZCoordinate=0)
move = Move(Geometry=pt1, Motion=T)  # -> Geometry, Transform
move_2 = Move(Geometry=pt2, Motion=T)  # -> Geometry, Transform
move_3 = Move(Geometry=pt3, Motion=T)  # -> Geometry, Transform
move_4 = Move(Geometry=pt4, Motion=T)  # -> Geometry, Transform
move_5 = Move(Geometry=pt5, Motion=T)  # -> Geometry, Transform
move_6 = Move(Geometry=pt6, Motion=T)  # -> Geometry, Transform
move_7 = Move(Geometry=pt7, Motion=T)  # -> Geometry, Transform
move_8 = Move(Geometry=pt8, Motion=T)  # -> Geometry, Transform
move_9 = Move(Geometry=pt9, Motion=T)  # -> Geometry, Transform
G = ClusterOutput(move.Geometry)
G_2 = ClusterOutput(move_2.Geometry)
G_3 = ClusterOutput(move_3.Geometry)
G_4 = ClusterOutput(move_4.Geometry)
G_5 = ClusterOutput(move_5.Geometry)
G_6 = ClusterOutput(move_6.Geometry)
G_7 = ClusterOutput(move_7.Geometry)
G_8 = ClusterOutput(move_8.Geometry)
G_9 = ClusterOutput(move_9.Geometry)
