# Grasshopper definition miuraRotatedStruct.gh (Grasshopper 1.0.7)
# plug-ins: Pufferfish

paper_length = Slider(25.5, range=1..36)
paper_height = Slider(18, range=1..36)
Y = UnitY(Factor=1)
X = UnitX(Factor=1)
amp = Amplitude(Vector=Y, Amplitude=expr("-2*x", paper_height))
rev = Reverse(Vector=X)
amp_2 = Amplitude(Vector=Y, Amplitude=expr("-2*x", paper_height))
amp_3 = Amplitude(Vector=Y, Amplitude=expr("-x", paper_height))
addition = Addition(A=amp, B=rev)
Y_2 = UnitY(Factor=1)
Y_3 = UnitY(Factor=1)
X_2 = UnitX(Factor=1)
path = FilePath("C:\Users\kl6599\OneDrive - Princeton University\Documents\MATLAB\Miura_Eggbox\giffolder\Frame_00000.png")
path_2 = FilePath("C:\Users\kl6599\OneDrive - Princeton University\Documents\MATLAB\Miura_Eggbox\giffolder\")
input_output_information = InputOutputInformation(SourcePath=path, TargetFolder=path_2, TargetFilename="miura_rotated_gif")  # -> IO; plug-in component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
frames_video = FramesToVideo(IO=input_output_information, Bitrate=12)  # -> Settings; plug-in component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
frames_gif = FramesToGIF(IO=input_output_information)  # -> Settings; plug-in component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
remote = FFmpegRemote(Settings=frames_video, Send=Button())  # plug-in component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

# ---- group: Input Sliders
tabangle = Slider(30, range=1..90)
tablength = Slider(0.25, range=0.1..1)
g1 = Slider(66.1, range=1..90)
g2 = Slider(60, range=1..90)
expression = Expression(x=g2, Expression="90-x")
rad = Radians(Degrees=tabangle)
xcount = Slider(2, range=1..10)
ycount = Slider(3, range=1..10)
zcount = Slider(3, range=1..10)
a = Slider(1.75, range=0.1..3)
b1 = Slider(2.22, range=0.1..3)
b2 = Slider(1.16, range=0.1..3)
expression_2 = Expression(x=rad, y=tablength, Expression="y/sin(x)")
rad_2 = Radians(Degrees=g1)
rad_3 = Radians(Degrees=g2)

dom = Domain(DomainStart=expr("x*1.001", expression), DomainEnd=expr("x*0.999", g1))
psi = Slider(1, range=0..1)
remap = RemapNumbers(Value=psi, Source=Domain(0, 1), Target=dom)
panel = Panel(remap)
num = Number(panel)

rad_4 = Radians(Degrees=num)

# ----
makemiura = MakeMiura(a=a, b=b2, g=rad_3, tabang=rad, tablength=expression_2, ny=ycount)  # -> cutlines, creaselines
makemiura_2 = MakeMiura(a=a, b=b1, g=rad_2, tabang=rad, tablength=expression_2, ny="1")  # -> cutlines, creaselines
makemiura_3 = MakeMiura(a=a, b=b1, g=rad_2, tabang=rad, tablength=expression_2, ny=ycount)  # -> cutlines, creaselines
makemiura_4 = MakeMiura(a=a, b=b2, g=rad_3, tabang=rad, tablength=expression_2, ny="1")  # -> cutlines, creaselines
expression_3 = Expression(x=rad_4, Expression="pi/2-x")
expression_4 = Expression(psi=rad_4, g=rad_2, Expression="asin(sin(psi)/sin(g))")
expression_5 = Expression(psi=expression_3, g=rad_3, Expression="asin(sin(psi)/sin(g))")
rotate = Rotate(Geometry=makemiura_3.cutlines, Angle="-pi/2", Plane=PlaneXY(0, 0, 0))  # -> Geometry, Transform
rotate_2 = Rotate(Geometry=makemiura_3.creaselines, Angle="-pi/2", Plane=PlaneXY(0, 0, 0))  # -> Geometry, Transform
rotate_3 = Rotate(Geometry=makemiura.cutlines, Angle="-pi/2", Plane=PlaneXY(0, 0, 0))  # -> Geometry, Transform
rotate_4 = Rotate(Geometry=makemiura.creaselines, Angle="-pi/2", Plane=PlaneXY(0, 0, 0))  # -> Geometry, Transform
mirror = Mirror(Geometry=makemiura_2.cutlines, Plane=PlaneYZ(0, 0, 0))  # -> Geometry, Transform
mirror_2 = Mirror(Geometry=makemiura_2.creaselines, Plane=PlaneYZ(0, 0, 0))  # -> Geometry, Transform
mirror_3 = Mirror(Geometry=makemiura_4.cutlines, Plane=PlaneYZ(0, 0, 0))  # -> Geometry, Transform
mirror_4 = Mirror(Geometry=makemiura_4.creaselines, Plane=PlaneYZ(0, 0, 0))  # -> Geometry, Transform
# Left Unit Cells Assuming Ny=Nz
expressiodn = Expression(N=ycount, Nx=xcount, Expression="(1+N)*N*Nx/2")
# Right Unit Cells Assuming Ny=Nz
expressiodn_2 = Expression(N=ycount, Nx=xcount, Expression="(N-1)*N*Nx/2")
move = Move(Geometry=makemiura_2.cutlines, Motion=amp_2)  # -> Geometry, Transform
move_2 = Move(Geometry=makemiura_2.creaselines, Motion=amp_2)  # -> Geometry, Transform
move_3 = Move(Geometry=makemiura_4.cutlines, Motion=amp_3)  # -> Geometry, Transform
move_4 = Move(Geometry=makemiura_4.creaselines, Motion=amp_3)  # -> Geometry, Transform
move_5 = Move(Geometry=mirror.Geometry, Motion=addition)  # -> Geometry, Transform
move_6 = Move(Geometry=mirror_2.Geometry, Motion=addition)  # -> Geometry, Transform
move_7 = Move(Geometry=mirror_3.Geometry, Motion=addition)  # -> Geometry, Transform
move_8 = Move(Geometry=mirror_4.Geometry, Motion=addition)  # -> Geometry, Transform
brec = BoundingRectangle(Geometry=[rotate_3.Geometry, rotate_4.Geometry], Plane=PlaneXY(0, 0, 0), Axis=0, Slide=0, Union=True)  # -> Bounding, DimensionX, DimensionY
brec_2 = BoundingRectangle(Geometry=[rotate.Geometry, rotate_2.Geometry], Plane=PlaneXY(0, 0, 0), Axis=0, Slide=0, Union=True)  # -> Bounding, DimensionX, DimensionY
expression_6 = Expression(b=b1, theta=expression_4, g=rad_2, Expression="b*cos(theta)*tan(g)/sqrt(1+cos(theta)^2*tan(g)^2)")
expression_7 = Expression(b=b2, theta=expression_5, g=rad_3, Expression="b*cos(theta)*tan(g)/sqrt(1+cos(theta)^2*tan(g)^2)")
move_9 = Move(Geometry=move_4.Geometry, Motion=amp_2)  # -> Geometry, Transform
move_10 = Move(Geometry=move_3.Geometry, Motion=amp_2)  # -> Geometry, Transform
move_11 = Move(Geometry=move_7.Geometry, Motion=amp_3)  # -> Geometry, Transform
move_12 = Move(Geometry=move_8.Geometry, Motion=amp_3)  # -> Geometry, Transform
expression_8 = Expression(a=a, theta=expression_4, g=rad_2, Expression="a*sqrt(1-sin(theta)^2*sin(g)^2)")
expression_9 = Expression(a=a, theta=expression_5, g=rad_3, Expression="a*sqrt(1-sin(theta)^2*sin(g)^2)")
brec_3 = BoundingRectangle(Geometry=[move.Geometry, move_2.Geometry], Plane=PlaneXY(0, 0, 0), Axis=0, Slide=0, Union=True)  # -> Bounding, DimensionX, DimensionY
brec_4 = BoundingRectangle(Geometry=[move_10.Geometry, move_9.Geometry], Plane=PlaneXY(0, 0, 0), Axis=0, Slide=0, Union=True)  # -> Bounding, DimensionX, DimensionY
expression_10 = Expression(a=a, theta=expression_4, g=rad_2, Expression="a*sin(theta)*sin(g)")
expression_11 = Expression(a=a, theta=expression_5, g=rad_3, Expression="a*sin(theta)*sin(g)")
division = Division(A=paper_length, B=brec_3.DimensionX)
division_2 = Division(A=paper_length, B=brec_4.DimensionX)
division_3 = Division(A=expressiodn_2, B=division)
division_4 = Division(A=expressiodn_2, B=division_2)
division_5 = Division(A=expressiodn, B=division)
division_6 = Division(A=expressiodn, B=division_2)
round = Round(Number=division_5)  # -> Nearest, Floor, Ceiling
round_2 = Round(Number=division_2)  # -> Nearest, Floor, Ceiling
round_3 = Round(Number=division_6)  # -> Nearest, Floor, Ceiling
round_4 = Round(Number=division)  # -> Nearest, Floor, Ceiling
round_5 = Round(Number=division_4)  # -> Nearest, Floor, Ceiling
round_6 = Round(Number=division_3)  # -> Nearest, Floor, Ceiling
arrrec = RectangularArray(Geometry=move_5.Geometry, Cell=brec_3.Bounding, XCount=expr("-x", round_4.Floor), YCount=round_6.Ceiling)  # -> Geometry, Transform
arrrec_2 = RectangularArray(Geometry=move_6.Geometry, Cell=brec_3.Bounding, XCount=expr("-x", round_4.Floor), YCount=round_6.Ceiling)  # -> Geometry, Transform
arrrec_3 = RectangularArray(Geometry=move_11.Geometry, Cell=brec_4.Bounding, XCount=expr("-x", round_2.Floor), YCount=round_5.Ceiling)  # -> Geometry, Transform
arrrec_4 = RectangularArray(Geometry=move_12.Geometry, Cell=brec_4.Bounding, XCount=expr("-x", round_2.Floor), YCount=round_5.Ceiling)  # -> Geometry, Transform
arrrec_5 = RectangularArray(Geometry=move.Geometry, Cell=brec_3.Bounding, XCount=round_4.Floor, YCount=round.Ceiling)  # -> Geometry, Transform
arrrec_6 = RectangularArray(Geometry=move_2.Geometry, Cell=brec_3.Bounding, XCount=round_4.Floor, YCount=round.Ceiling)  # -> Geometry, Transform
arrrec_7 = RectangularArray(Geometry=move_10.Geometry, Cell=brec_4.Bounding, XCount=round_2.Floor, YCount=round_3.Ceiling)  # -> Geometry, Transform
arrrec_8 = RectangularArray(Geometry=move_9.Geometry, Cell=brec_4.Bounding, XCount=round_2.Floor, YCount=round_3.Ceiling)  # -> Geometry, Transform
flatten = FlattenTree(Tree=[arrrec_5.Geometry, arrrec_6.Geometry], Path="{0}")
expression_12 = Expression(S=expression_6, theta=expression_4, g=rad_2, Expression="S/(tan(g)*cos(theta))")
expression_13 = Expression(S=expression_7, theta=expression_5, g=rad_3, Expression="S/(tan(g)*cos(theta))")
flatten_2 = FlattenTree(Tree=[arrrec_7.Geometry, arrrec_8.Geometry], Path="{0}")
expression_14 = Expression(x=expression_6, Expression="2*x")
expression_15 = Expression(x=expression_7, Expression="2*x")
brec_5 = BoundingRectangle(Geometry=flatten, Plane=PlaneXY(0, 0, 0), Axis=0, Slide=0, Union=True)  # -> Bounding, DimensionX, DimensionY
brec_6 = BoundingRectangle(Geometry=flatten_2, Plane=PlaneXY(0, 0, 0), Axis=0, Slide=0, Union=True)  # -> Bounding, DimensionX, DimensionY
expression_16 = Expression(x=expression_8, Expression="2*x")
subtraction = Subtraction(A=expression_13, B=expression_9)
expression_17 = Expression(x=brec_5.DimensionY, Expression="x/2")
expression_18 = Expression(x=brec_6.DimensionY, Expression="x/2")
addition_2 = Addition(A=expression_13, B=expression_9)
addition_3 = Addition(A=expression_15, B=expression_14)
boxprop = BoxProperties(Box=brec_5.Bounding)  # -> Center, Diagonal, Area, Volume, Degeneracy
boxprop_2 = BoxProperties(Box=brec_6.Bounding)  # -> Center, Diagonal, Area, Volume, Degeneracy
addition_4 = Addition(A=expression_7, B=expression_14)
addition_5 = Addition(A=expression_12, B=expression_16)
addition_6 = Addition(A=expression_12, B=expression_8)
devec = DeconstructVector(Vector=boxprop.Center)  # -> XComponent, YComponent, ZComponent
addition_7 = Addition(A=devec.YComponent, B=expression_17)
devec_2 = DeconstructVector(Vector=boxprop_2.Center)  # -> XComponent, YComponent, ZComponent
addition_8 = Addition(A=devec_2.YComponent, B=expression_18)
amp_4 = Amplitude(Vector=Y_2, Amplitude=addition_7)
amp_5 = Amplitude(Vector=Y_3, Amplitude=addition_8)

# ---- group: Points
pt3 = ConstructPoint(XCoordinate=0, YCoordinate=expr("2*x", expression_8), ZCoordinate=0)
pt7 = ConstructPoint(XCoordinate=expr("2*x", expression_6), YCoordinate=0, ZCoordinate=0)
pt8 = ConstructPoint(XCoordinate=expr("2*x", expression_6), YCoordinate=expression_8, ZCoordinate=expression_10)
pt9 = ConstructPoint(XCoordinate=expr("2*x", expression_6), YCoordinate=expr("2*x", expression_8), ZCoordinate=0)
pt10 = ConstructPoint(XCoordinate=0, YCoordinate=expression_8, ZCoordinate=expr("-x", expression_10))
pt11 = ConstructPoint(XCoordinate=expression_6, YCoordinate=addition_6, ZCoordinate=expr("-x", expression_10))
pt12 = ConstructPoint(XCoordinate=expr("2*x", expression_6), YCoordinate=expression_8, ZCoordinate=expr("-x", expression_10))
pt15 = ConstructPoint(XCoordinate=addition_4, YCoordinate=expr("2*x", expression_11), ZCoordinate=expression_13)
pt18 = ConstructPoint(XCoordinate=addition_3, YCoordinate=expr("2*x", expression_11), ZCoordinate=0)
pt20 = ConstructPoint(XCoordinate=addition_3, YCoordinate=expression_11, ZCoordinate=expr("-x", expression_10))
pt1 = ConstructPoint(XCoordinate=0, YCoordinate=0, ZCoordinate=0)
pt2 = ConstructPoint(XCoordinate=0, YCoordinate=expression_8, ZCoordinate=expression_10)
pt4 = ConstructPoint(XCoordinate=expression_6, YCoordinate=expression_12, ZCoordinate=0)
pt5 = ConstructPoint(XCoordinate=expression_6, YCoordinate=addition_6, ZCoordinate=expression_10)
pt6 = ConstructPoint(XCoordinate=expression_6, YCoordinate=addition_5, ZCoordinate=0)
pt13 = ConstructPoint(XCoordinate=addition_4, YCoordinate=0, ZCoordinate=expression_13)
pt4_2 = ConstructPoint(XCoordinate=addition_4, YCoordinate=expression_11, ZCoordinate=addition_2)
pt16 = ConstructPoint(XCoordinate=addition_3, YCoordinate=0, ZCoordinate=0)
pt17 = ConstructPoint(XCoordinate=addition_3, YCoordinate=expression_11, ZCoordinate=expression_9)
pt19 = ConstructPoint(XCoordinate=addition_4, YCoordinate=expression_11, ZCoordinate=subtraction)

# ----
addition_9 = Addition(A=amp_4, B=X_2)
addition_10 = Addition(A=amp_5, B=X_2)
move_13 = Move(Geometry=rotate.Geometry, Motion=addition_9)  # -> Geometry, Transform
move_14 = Move(Geometry=rotate_2.Geometry, Motion=addition_9)  # -> Geometry, Transform
move_15 = Move(Geometry=rotate_3.Geometry, Motion=addition_10)  # -> Geometry, Transform
move_16 = Move(Geometry=rotate_4.Geometry, Motion=addition_10)  # -> Geometry, Transform

# ---- group: Surfaces
merge = Merge(Data1=pt1, Data2=pt2, Data3=pt4, Data4=pt5)
merge_2 = Merge(Data1=pt2, Data2=pt3, Data3=pt5, Data4=pt6)
merge_3 = Merge(Data1=pt4, Data2=pt5, Data3=pt7, Data4=pt8)
merge_4 = Merge(Data1=pt5, Data2=pt6, Data3=pt8, Data4=pt9)
merge_5 = Merge(Data1=pt1, Data2=pt10, Data3=pt4, Data4=pt11)
merge_6 = Merge(Data1=pt10, Data2=pt3, Data3=pt11, Data4=pt6)
merge_7 = Merge(Data1=pt4, Data2=pt11, Data3=pt7, Data4=pt12)
merge_8 = Merge(Data1=pt11, Data2=pt6, Data3=pt12, Data4=pt9)
merge_9 = Merge(Data1=pt7, Data2=pt8, Data3=pt13, Data4=pt4_2)
merge_10 = Merge(Data1=pt8, Data2=pt9, Data3=pt4_2, Data4=pt15)
merge_11 = Merge(Data1=pt13, Data2=pt4_2, Data3=pt16, Data4=pt17)
merge_12 = Merge(Data1=pt4_2, Data2=pt15, Data3=pt17, Data4=pt18)
merge_13 = Merge(Data1=pt7, Data2=pt12, Data3=pt13, Data4=pt19)
merge_14 = Merge(Data1=pt12, Data2=pt9, Data3=pt19, Data4=pt15)
merge_15 = Merge(Data1=pt13, Data2=pt19, Data3=pt16, Data4=pt20)
merge_16 = Merge(Data1=pt19, Data2=pt15, Data3=pt20, Data4=pt18)
srfgrid = SurfaceFromPoints(Points=merge, UCount=2, Interpolate=False)
srfgrid_2 = SurfaceFromPoints(Points=merge_2, UCount=2, Interpolate=False)
srfgrid_3 = SurfaceFromPoints(Points=merge_3, UCount=2, Interpolate=False)
srfgrid_4 = SurfaceFromPoints(Points=merge_4, UCount=2, Interpolate=False)
srfgrid_5 = SurfaceFromPoints(Points=merge_5, UCount=2, Interpolate=False)
srfgrid_6 = SurfaceFromPoints(Points=merge_6, UCount=2, Interpolate=False)
srfgrid_7 = SurfaceFromPoints(Points=merge_7, UCount=2, Interpolate=False)
srfgrid_8 = SurfaceFromPoints(Points=merge_8, UCount=2, Interpolate=False)
srfgrid_9 = SurfaceFromPoints(Points=merge_9, UCount=2, Interpolate=False)
srfgrid_10 = SurfaceFromPoints(Points=merge_10, UCount=2, Interpolate=False)
srfgrid_11 = SurfaceFromPoints(Points=merge_11, UCount=2, Interpolate=False)
srfgrid_12 = SurfaceFromPoints(Points=merge_12, UCount=2, Interpolate=False)
srfgrid_13 = SurfaceFromPoints(Points=merge_13, UCount=2, Interpolate=False)
srfgrid_14 = SurfaceFromPoints(Points=merge_14, UCount=2, Interpolate=False)
srfgrid_15 = SurfaceFromPoints(Points=merge_15, UCount=2, Interpolate=False)
srfgrid_16 = SurfaceFromPoints(Points=merge_16, UCount=2, Interpolate=False)

# ----
mirror_5 = Mirror(Geometry=move_15.Geometry, Plane=PlaneYZ(0, 0, 0))  # -> Geometry, Transform
mirror_6 = Mirror(Geometry=move_13.Geometry, Plane=PlaneYZ(0, 0, 0))  # -> Geometry, Transform
mirror_7 = Mirror(Geometry=move_16.Geometry, Plane=PlaneYZ(0, 0, 0))  # -> Geometry, Transform
mirror_8 = Mirror(Geometry=move_14.Geometry, Plane=PlaneYZ(0, 0, 0))  # -> Geometry, Transform
cutlines = Merge(
    Data1=arrrec_5.Geometry,
    Data2=arrrec_7.Geometry,
    Data3=mirror_6.Geometry,
    Data4=mirror_5.Geometry,
    Data5=arrrec.Geometry,
    Data6=arrrec_3.Geometry)
creaselines = Merge(
    Data1=arrrec_6.Geometry,
    Data2=arrrec_8.Geometry,
    Data3=mirror_8.Geometry,
    Data4=mirror_7.Geometry,
    Data5=arrrec_2.Geometry,
    Data6=arrrec_4.Geometry)
expression_19 = Expression(x=expression_6, y=expression_7, Expression="2*(x+y)")
tube_unit_cell = Merge(
    Data1=srfgrid,
    Data2=srfgrid_2,
    Data3=srfgrid_3,
    Data4=srfgrid_4,
    Data5=srfgrid_5,
    Data6=srfgrid_6,
    Data7=srfgrid_7,
    Data8=srfgrid_8,
    Data9=srfgrid_9,
    Data10=srfgrid_10,
    Data11=srfgrid_11,
    Data12=srfgrid_12,
    Data13=srfgrid_13,
    Data14=srfgrid_14,
    Data15=srfgrid_15,
    Data16=srfgrid_16)
group = Group(Objects=tube_unit_cell)
series = Series(Start=0, Step=expression_19, Count=xcount)
vec = VectorXYZ(XComponent=series, YComponent=0, ZComponent=0)  # -> Vector, Length
move_17 = Move(Geometry=group, Motion=vec.Vector)  # -> Geometry, Transform
series_2 = Series(Start=0, Step=expression_8, Count=ycount)
series_3 = Series(Start=0, Step=expression_10, Count=ycount)
series_4 = Series(Start=0, Step=expr("-x", expression_8), Count=zcount)
group_2 = Group(Objects=move_17.Geometry)
vec_2 = VectorXYZ(XComponent=0, YComponent=series_2, ZComponent=series_3)  # -> Vector, Length
series_5 = Series(Start=0, Step=expression_10, Count=zcount)
move_18 = Move(Geometry=group_2, Motion=vec_2.Vector)  # -> Geometry, Transform
vec_3 = VectorXYZ(XComponent=0, YComponent=series_4, ZComponent=series_5)  # -> Vector, Length
group_3 = Group(Objects=move_18.Geometry)
move_19 = Move(Geometry=group_3, Motion=vec_3.Vector)  # -> Geometry, Transform
group_4 = Group(Objects=move_19.Geometry)

# ==== cluster MakeMiura
tablength = ClusterInput()
ny = ClusterInput()
a = ClusterInput()
b = ClusterInput()
g = ClusterInput()
tabang = ClusterInput()
tablength_2 = Number(tablength)
ny_2 = Number(ny)
a_2 = Number(a)
b_2 = Number(b)
g_2 = Number(g)
tabang_2 = Number(tabang)

# ---- group: Make Miura
expression = Expression(b=b_2, g=g_2, Expression="b*sin(g)")
expression_2 = Expression(b=b_2, g=g_2, Expression="b*cos(g)")
expression_3 = Expression(a=a_2, Nx=ny_2, Expression="2*a*Nx")
expression_4 = Expression(x=expression, Expression="2*x")
addition = Addition(A=expression_3, B=expression_2)
addition_2 = Addition(A=a_2, B=expression_2)
pt = ConstructPoint(XCoordinate=0, YCoordinate=0, ZCoordinate=0)
pt_2 = ConstructPoint(XCoordinate=0, YCoordinate=a_2, ZCoordinate=0)
pt_3 = ConstructPoint(XCoordinate=0, YCoordinate=expression_3, ZCoordinate=0)
pt_4 = ConstructPoint(XCoordinate=expression, YCoordinate=expression_2, ZCoordinate=0)
pt_5 = ConstructPoint(XCoordinate=expression, YCoordinate=addition_2, ZCoordinate=0)
pt_6 = ConstructPoint(XCoordinate=expression, YCoordinate=addition, ZCoordinate=0)
pt_7 = ConstructPoint(XCoordinate=expression_4, YCoordinate=0, ZCoordinate=0)
pt_8 = ConstructPoint(XCoordinate=expression_4, YCoordinate=a_2, ZCoordinate=0)
pt_9 = ConstructPoint(XCoordinate=expression_4, YCoordinate=expression_3, ZCoordinate=0)
merge = Merge(Data1=pt_2, Data2=pt_5, Data3=pt_8)
pline = PolyLine(Vertices=merge, Closed=False)
merge_2 = Merge(Data1=pt_7, Data2=pt_4, Data3=pt, Data4=pt_3, Data5=pt_6, Data6=pt_9)
merge_3 = Merge(Data1=pt_4, Data2=pt_5, Data3=pt_6)
pline_2 = PolyLine(Vertices=merge_3, Closed=False)
pline_3 = PolyLine(Vertices=[pt_7, pt_9], Closed=False)
pline_4 = PolyLine(Vertices=merge_2, Closed=False)

# ----
expression_5 = Expression(x=ny_2, Expression="2*x-1")
rectangle = Rectangle(Plane=PlaneXY(0, 0, 0), XSize=expression_4, YSize=a_2, Radius=0)  # -> Rectangle, Length
arrrec = RectangularArray(Geometry=pline, Cell=rectangle.Rectangle, XCount=1, YCount=expression_5)  # -> Geometry, Transform
merge_4 = Merge(Data1=pline_4, Data2=arrrec.Geometry, Data3=pline_2)
flatten = FlattenTree(Tree=merge_4, Path="{0}")
creaselines = ClusterOutput(flatten)

# ---- group: Make Tabs
vec2pt = Vector2Pt(PointA=pt, PointB=pt_2, Unitize=True)  # -> Vector, Length
vec2pt_2 = Vector2Pt(PointA=pt, PointB=pt_4, Unitize=True)  # -> Vector, Length
vec2pt_3 = Vector2Pt(PointA=pt_4, PointB=pt, Unitize=True)  # -> Vector, Length
rotate = Rotate(Geometry=vec2pt_2.Vector, Angle=expr("-x", tabang_2), Plane=PlaneXY(0, 0, 0))  # -> Geometry, Transform
rotate_2 = Rotate(Geometry=vec2pt_3.Vector, Angle=tabang_2, Plane=PlaneXY(0, 0, 0))  # -> Geometry, Transform
rotate_3 = Rotate(Geometry=vec2pt.Vector, Angle=tabang_2, Plane=PlaneXY(0, 0, 0))  # -> Geometry, Transform
Y = UnitY(Factor=1)
amp = Amplitude(Vector=rotate.Geometry, Amplitude=tablength_2)
amp_2 = Amplitude(Vector=rotate_2.Geometry, Amplitude=tablength_2)
amp_3 = Amplitude(Vector=rotate_3.Geometry, Amplitude=tablength_2)
move = Move(Geometry=pt, Motion=amp)  # -> Geometry, Transform
move_2 = Move(Geometry=pt_4, Motion=amp_2)  # -> Geometry, Transform
devec = DeconstructVector(Vector=amp_3)  # -> XComponent, YComponent, ZComponent
expression_6 = Expression(x=a_2, y=devec.YComponent, Expression="x-2*y")
amp_4 = Amplitude(Vector=Y, Amplitude=expression_6)
move_3 = Move(Geometry=pt, Motion=amp_3)  # -> Geometry, Transform
move_4 = Move(Geometry=move_3.Geometry, Motion=amp_4)  # -> Geometry, Transform
merge_5 = Merge(Data1=pt, Data2=move_3.Geometry, Data3=move_4.Geometry, Data4=pt_2)
merge_6 = Merge(Data1=pt, Data2=move.Geometry, Data3=move_2.Geometry, Data4=pt_4)
yz = YZPlane(Origin=Point(0, 0, 0))
Y_2 = UnitY(Factor=1)
rotate_4 = Rotate(Geometry=yz, Angle=expr("-x", g_2), Plane=PlaneXY(0, 0, 0))  # -> Geometry, Transform
expression_7 = Expression(x=ny_2, Expression="2*x")
pline_5 = PolyLine(Vertices=merge_5, Closed=False)
amp_5 = Amplitude(Vector=Y_2, Amplitude=a_2)
vec2pt_4 = Vector2Pt(PointA=pt, PointB=pt_3, Unitize=False)  # -> Vector, Length
yz_2 = YZPlane(Origin=pt_4)
arrlinear = LinearArray(Geometry=pline_5, Direction=amp_5, Count=expression_7)  # -> Geometry, Transform

# ----
pline_6 = PolyLine(Vertices=merge_6, Closed=False)

# ---- group: Make Tabs (continued)
mirror = Mirror(Geometry=pline_6, Plane=rotate_4.Geometry)  # -> Geometry, Transform
move_5 = Move(Geometry=mirror.Geometry, Motion=vec2pt_4.Vector)  # -> Geometry, Transform
mirror_2 = Mirror(Geometry=[pline_6, move_5.Geometry], Plane=yz_2)  # -> Geometry, Transform

# ----
merge_7 = Merge(Data1=mirror_2.Geometry, Data2=pline_6, Data3=arrlinear.Geometry, Data4=move_5.Geometry, Data5=pline_3)
flatten_2 = FlattenTree(Tree=merge_7, Path="{0}")
cutlines = ClusterOutput(flatten_2)
