# Grasshopper definition miura_cutout_cell.gh (Grasshopper 1.0.7)

b = Number()
g = Number()
a = Number()
b_2 = Number(b)
g_2 = Number(g)
a_2 = Number(a)
g_3 = Number(g_2)
a_3 = Number(a_2)

# ---- group: Make Miura
expression = Expression(b=b_2, g=g_2, Expression="b*sin(g)")
expression_2 = Expression(b=b_2, g=g_2, Expression="b*cos(g)")
expression_3 = Expression(a=a_2, Expression="2*a")
expression_4 = Expression(x=expression, Expression="2*x")
addition = Addition(A=expression_3, B=expression_2)
addition_2 = Addition(A=a_2, B=expression_2)
pt = ConstructPoint(XCoordinate=0, YCoordinate=0, ZCoordinate=0)
pt_2 = ConstructPoint(XCoordinate=0, YCoordinate=a_2, ZCoordinate=0)
pt_3 = ConstructPoint(XCoordinate=0, YCoordinate=expression_3, ZCoordinate=0)
pt_4 = ConstructPoint(XCoordinate=expression, YCoordinate=expression_2, ZCoordinate=0)
pt_5 = ConstructPoint(XCoordinate=expression, YCoordinate=addition_2, ZCoordinate=0)
pt_6 = ConstructPoint(XCoordinate=expression, YCoordinate=addition, ZCoordinate=0)
pt_7 = ConstructPoint(XCoordinate=expression_4, YCoordinate=0, ZCoordinate=0)
pt_8 = ConstructPoint(XCoordinate=expression_4, YCoordinate=a_2, ZCoordinate=0)
pt_9 = ConstructPoint(XCoordinate=expression_4, YCoordinate=expression_3, ZCoordinate=0)
merge = Merge(Data1=pt_7, Data2=pt_4, Data3=pt, Data4=pt_2, Data5=pt_3, Data6=pt_6, Data7=pt_9)
merge_2 = Merge(Data1=pt_2, Data2=pt_5, Data3=pt_8)
merge_3 = Merge(Data1=pt_4, Data2=pt_5, Data3=pt_6)
pline = PolyLine(Vertices=merge_3, Closed=False)
pline_2 = PolyLine(Vertices=[pt_7, pt_9], Closed=False)
pline_3 = PolyLine(Vertices=merge, Closed=False)
pline_4 = PolyLine(Vertices=merge_2, Closed=False)

# ----
pt_10 = Point(pt)
pt_11 = Point(pt_2)
pt_12 = Point(pt_3)
pt_13 = Point(pt_4)
pl = Polyline(pline)
pl_2 = Polyline(pline_2)
pl_3 = Polyline(pline_3)
pl_4 = Polyline(pline_4)
