# Grasshopper definition miura_cutouts.gh (Grasshopper 1.0.7)

b = VariableB()
g = VariableG()
a = VariableA()
A = A()
Y = YCoordinate()
Y_2 = YCoordinate()
A_2 = Angle()
A_3 = Angle()
A_4 = Amplitude()
A_5 = Amplitude()

# ---- group: Make Miura
expression = Expression(b=b, g=g, Expression="b*sin(g)")
expression_2 = Expression(b=b, g=g, Expression="b*cos(g)")
expression_3 = Expression(a=a, Expression="2*a")
expression_4 = Expression(x=expression, Expression="2*x")
addition = Addition(A=expression_3, B=expression_2)
addition_2 = Addition(A=A, B=expression_2)
pt = ConstructPoint(XCoordinate=0, YCoordinate=0, ZCoordinate=0)
pt_2 = ConstructPoint(XCoordinate=0, YCoordinate=Y, ZCoordinate=0)
pt_3 = ConstructPoint(XCoordinate=0, YCoordinate=expression_3, ZCoordinate=0)
pt_4 = ConstructPoint(XCoordinate=expression, YCoordinate=expression_2, ZCoordinate=0)
pt_5 = ConstructPoint(XCoordinate=expression, YCoordinate=addition_2, ZCoordinate=0)
pt_6 = ConstructPoint(XCoordinate=expression, YCoordinate=addition, ZCoordinate=0)
pt_7 = ConstructPoint(XCoordinate=expression_4, YCoordinate=0, ZCoordinate=0)
pt_8 = ConstructPoint(XCoordinate=expression_4, YCoordinate=Y_2, ZCoordinate=0)
pt_9 = ConstructPoint(XCoordinate=expression_4, YCoordinate=expression_3, ZCoordinate=0)
vec2pt = Vector2Pt(PointA=pt, PointB=pt_4, Unitize=True)  # -> Vector, Length
vec2pt_2 = Vector2Pt(PointA=pt_4, PointB=pt, Unitize=True)  # -> Vector, Length
vec2pt_3 = Vector2Pt(PointA=pt, PointB=pt_3, Unitize=False)  # -> Vector, Length
rotate = Rotate(Geometry=vec2pt.Vector, Angle=expr("-x", A_2), Plane=PlaneXY(0, 0, 0))  # -> Geometry, Transform
rotate_2 = Rotate(Geometry=vec2pt_2.Vector, Angle=A_3, Plane=PlaneXY(0, 0, 0))  # -> Geometry, Transform
amp = Amplitude(Vector=rotate.Geometry, Amplitude=A_4)
amp_2 = Amplitude(Vector=rotate_2.Geometry, Amplitude=A_5)
move = Move(Geometry=pt, Motion=amp)  # -> Geometry, Transform
move_2 = Move(Geometry=pt_4, Motion=amp_2)  # -> Geometry, Transform
merge = Merge(Data1=pt_2, Data2=pt_5, Data3=pt_8)
merge_2 = Merge(Data1=pt_4, Data2=pt_5, Data3=pt_6)
merge_3 = Merge(Data1=pt_7, Data2=pt_4, Data3=pt, Data4=pt_2, Data5=pt_3, Data6=pt_6, Data7=pt_9)
pline = PolyLine(Vertices=merge_2, Closed=False)
pline_2 = PolyLine(Vertices=[pt_7, pt_9], Closed=False)
pline_3 = PolyLine(Vertices=merge_3, Closed=False)
pline_4 = PolyLine(Vertices=merge, Closed=False)

# ----
pt_10 = Point(pt)
pt_11 = Point(pt_2)
pt_12 = Point(pt_4)
V = Vector(vec2pt_3.Vector)
G = Geometry(move.Geometry)
G_2 = Geometry(move_2.Geometry)
pl = Polyline(pline)
pl_2 = Polyline(pline_2)
pl_3 = Polyline(pline_3)
pl_4 = Polyline(pline_4)
